# Grasshopper definition surface_mapping_network.gh (Grasshopper 1.0.7)

number_slider = Slider(3000, range=0..3000)
number_slider_2 = Slider(3, range=0..10)
planesrf = PlaneSurface(Plane=PlaneXY(0, 0, 0), XSize=number_slider, YSize=number_slider)
series = Series(Start=0, Step=number_slider, Count=number_slider_2)
series_2 = Series(Start=0, Step=number_slider, Count=Slider(4, range=0..10))

# ---- group: cylinder as looping surfaces
cyl = Cylinder(Base=PlaneXY(0, 0, 0), Radius=Slider(3500, range=0..4000), Length=Slider(9000, range=0..10000))
python = GhPythonScript()  # -> out, a
# ---------- python: Python ----------
__author__ = "ytakzk"
__version__ = "2019.02.23"

import Rhino.Geometry as rg

a = []

for i in range(3):
    
    a.append(rg.Interval(i/3, (i + 1)/3))
# ---------- end python ----------
dom² = ConstructDomain²(DomainU=python.a, DomainV=graft(python.a))  # -> flatten(_2DDomain)
subsrf = Isotrim(Surface=reparameterize(cyl), Domain=dom²)
python_2 = GhPythonScript(x=subsrf)  # -> out, cylinder_surfaces; inputs x: list of Surface
# ---------- python_2: Python ----------
__author__ = "ytakzk"
__version__ = "2019.02.23"

import Rhino.Geometry as rg

#for s in x[3:6]:
#
#    s.Reverse(0, True)
#    domain = rg.Interval(0, 1)
#    s.SetDomain(0, domain)

cylinder_surfaces = x
# ---------- end python_2 ----------

# ----
X = UnitX(Factor=series)
Y = UnitY(Factor=series_2)  # -> graft(UnitVector)
move = Move(Geometry=planesrf, Motion=X)  # -> Geometry, Transform
move_2 = Move(Geometry=move.Geometry, Motion=Y)  # -> flatten(Geometry), Transform

# ---- group: keystone surfaces 2
srf = Surface([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])

# ----
srf_2 = Surface(move_2.Geometry)

# ---- group: Jonas's surfaces
srf_3 = Surface([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])
python_3 = GhPythonScript(surfaces=srf_3)  # -> out, a; inputs surfaces: list of Surface
# ---------- python_3: Python ----------
__author__ = "ytakzk"
__version__ = "2019.02.24"

import Rhino.Geometry as rg

a = []

for i, s in enumerate(surfaces):
    
#    domain = rg.Interval(0, 1)
#    
#    if i > 1:
#        s = s.Reverse(0)
#        s.SetDomain(0, domain)
    
    a.append(s)
# ---------- end python_3 ----------

# ----
srf_4 = Surface([<surface referenced from the Rhino model> x39])

# ---- group: in reality, must be done manually
python_4 = GhPythonScript(surfaces=srf_2, u_num=number_slider_2)  # -> out, organized_surfaces; inputs surfaces: list of Surface, u_num: Int32
# ---------- python_4: Python ----------
__author__ = "ytakzk"
__version__ = "2019.02.20"

import Rhino.Geometry as rg

organized_surfaces = []

for i, s in enumerate(surfaces):
    
    x = i % u_num
    y = int(i / u_num)
    
    domain = rg.Interval(0, 1)
    
#    if (x + y) % 2 == 1:
#        s = s.Reverse(1)
#        s.SetDomain(1, domain)
#        s = s.Reverse(0)
#        s.SetDomain(0, domain)

    if y % 2 == 1:
#        s = s.Reverse(1)
#        s.SetDomain(1, domain)
        s = s.Reverse(0)
        s.SetDomain(0, domain)
    
    if x == u_num - 1:
        s = s.Reverse(0)
        s.SetDomain(0, domain)
        
    organized_surfaces.append(s)
# ---------- end python_4 ----------

# ---- group: one surface
item = ListItem(List=srf_2, Index=0, Wrap=True)
srf_5 = Surface(item)

# ----
python_5 = GhPythonScript(surfaces=srf)  # -> out, organized_surfaces; inputs surfaces: list of Surface
# ---------- python_5: Python ----------
__author__ = "ytakzk"
__version__ = "2019.02.25"

import Rhino.Geometry as rg

organized_surfaces = []

for i, s in enumerate(surfaces):
    
#    if i == 0 or i == 1 or i == 5:
#        s.Reverse(0, True)
#        domain = rg.Interval(0, 1)
#        s.SetDomain(0, domain)
    
    organized_surfaces.append(s)
# ---------- end python_5 ----------

# ---- group: keystone surfaces
srf_6 = Surface([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])

# ----
srf_7 = Surface(srf)
item_2 = ListItem(List=srf_7, Index=0, Wrap=True)

# ---- group: local network generation
panel = Panel("""3,0
1,2
4,5""")  # disabled
panel_2 = Panel("""False
False
True""")  # disabled
panel_3 = Panel("""0
2
4""")  # disabled
python_6 = GhPythonScript(surfaces=srf_7, surface_network_index=panel, top_priority_index=panel_3, has_loops=panel_2)  # -> out, beams, dowels, local_networks; inputs surfaces: list of Surface, surface_network_index: list, top_priority_index: list of Int32, has_loops: list of Boolean; disabled
# ---------- python_6: Python ----------
__author__ = "ytakzk"
__version__ = "2019.02.23"

import sys
import Rhino.Geometry as rg

from geometry import LocalNetwork, Surface

dowels = []
beams = []
tmp = []
local_networks = []

if len(surface_network_index) != len(top_priority_index):
    ValueError('surface_network_index must be the same size as top_priority_index')

# network

surface_network_sets = []
priorities = []

for string, priority_index in zip(surface_network_index, top_priority_index):
    
    values = string.split('&')

    surface_network = []
    
    priority_index_v = 0
    
    for v_values in values:

        surface_network_subset = []
        for v, index in enumerate(v_values.split(',')):
            
            index = int(index)

            if index == priority_index:
                
                priority_index_v = v
                
            surface = Surface(surfaces[index])
            surface_network_subset.append(surface)
            
        surface_network.append(surface_network_subset)
    
    priorities.append(priority_index_v)
    
    surface_network_sets.append(surface_network)

for surface_network, has_loop, top_priority_v_index in zip(surface_network_sets, has_loops, priorities):

    local_network = LocalNetwork(surface_network, has_loop, top_priority_v_index)

    local_dowels = local_network.add_three_beams_connection()
    dowels.extend([d.brep_representation() for d in local_dowels])

    local_dowels = local_network.add_two_beams_connection()
    dowels.extend([d.brep_representation() for d in local_dowels])

    local_beams = [b.brep_representation(make_holes=False) for b in local_network.get_flatten_beams()]
    beams.extend(local_beams)
    
    local_networks.append(local_network)
# ---------- end python_6 ----------

# ----
srf_8 = Surface(<surface referenced from the Rhino model>)

# ---- group: surface visualization
python_7 = GhPythonScript(s=srf_7)  # -> out, c; inputs s: Surface
# ---------- python_7: Python ----------
__author__ = "ytakzk"
__version__ = "2019.02.26"

import Rhino.Geometry as rg


domain = rg.Interval(0, 1)
s.SetDomain(0, domain)
s.SetDomain(1, domain)

c = s.PointAt(0.5, 0.5)
# ---------- end python_7 ----------
panel_4 = Panel("600")
points = PointList(Points=python_7.c, Size=panel_4)
uvn = UVN(srf=srf_8)

# ---- group: local network generation
python_8 = GhPythonScript(surfaces=srf_8, surface_network_index="0", top_priority_index="0", has_loops="False")  # -> out, beams, dowels, local_networks; inputs surfaces: list of Surface, surface_network_index: list, top_priority_index: list of Int32, has_loops: list of Boolean
# ---------- python_8: Python ----------
__author__ = "ytakzk"
__version__ = "2019.02.23"

import sys
import Rhino.Geometry as rg
import geometry.local_network
import geometry.surface
reload(geometry.local_network)
reload(geometry.surface)
from geometry.local_network import LocalNetwork
from geometry.surface import Surface


dowels = []
beams = []
tmp = []
local_networks = []

if len(surface_network_index) != len(top_priority_index):
    ValueError('surface_network_index must be the same size as top_priority_index')

# network

surface_network_sets = []
priorities = []

for string, priority_index in zip(surface_network_index, top_priority_index):
    
    values = string.split('&')

    surface_network = []
    
    priority_index_v = 0
    
    for v_values in values:

        surface_network_subset = []
        for v, index in enumerate(v_values.split(',')):
            
            index = int(index)

            if index == priority_index:
                
                priority_index_v = v
                
            surface = Surface(surfaces[index])
            surface_network_subset.append(surface)
            
        surface_network.append(surface_network_subset)
    
    priorities.append(priority_index_v)
    
    surface_network_sets.append(surface_network)

for surface_network, has_loop, top_priority_v_index in zip(surface_network_sets, has_loops, priorities):

    local_network = LocalNetwork(surface_network, has_loop, top_priority_v_index)

    local_dowels = local_network.add_three_beams_connection()
    dowels.extend([d.brep_representation() for d in local_dowels])

    local_dowels = local_network.add_two_beams_connection()
    dowels.extend([d.brep_representation() for d in local_dowels])

    local_beams = [b.brep_representation(make_holes=False) for b in local_network.get_flatten_beams()]
    beams.extend(local_beams)
    
    local_networks.append(local_network)
# ---------- end python_8 ----------

# ----
number_slider_3 = Slider(2, range=-10..10)  # disabled
panel_5 = Panel(python_8.out)

# ---- group: keystone generation
panel_6 = Panel("""2,3,4
1,0,5""")  # disabled
python_9 = GhPythonScript(surfaces=srf_7, keystone_index_list=panel_6, a=number_slider_3)  # -> out, keystone_surfaces; inputs surfaces: list of Surface, a: Int32; disabled
# ---------- python_9: Python ----------
__author__ = "ytakzk"
__version__ = "2019.02.24"

import System
import Rhino.Geometry as rg
import Grasshopper.Kernel.Data.GH_Path as ghpath
import Grasshopper.DataTree as datatree
from geometry import Keystone

keystone_surfaces = datatree[System.Object]()

# ceonvert string to nested numerical list

index_nested_list = []

for vals in keystone_index_list.split('\n'):
    print vals
    nums = [int(v) for v in vals.split(',')]
    index_nested_list.append(nums)

print index_nested_list

#for i, index_list in enumerate(index_nested_list):
#    
#    surfaces = [surfaces[i] for i in index_list]
#
#    keystone = Keystone(surfaces, split_function=1)
#    _, generated_surfaces = keystone.output()
#    
#    for s in generated_surfaces:
#        path = ghpath(i)
#        keystone_surfaces.Add(s, path)

nested_surfaces = []
for index_list in index_nested_list:
    
    tmp_surfaces = [surfaces[i] for i in index_list]

    nested_surfaces.append(tmp_surfaces)

keystone = Keystone(nested_surfaces, split_function=1, f_args = [[0, 0, .15, .05], [a, 0, .15, .05], []], loc_pat = [0, 1], blend_overlap = 5, dir = True)
_, generated_surfaces = keystone.output()

for i, s_list in enumerate(generated_surfaces):
    path = ghpath(i)
    
    for s in s_list:
        keystone_surfaces.Add(s, path)
# ---------- end python_9 ----------
preview = CustomPreview(
    Geometry=python_9.keystone_surfaces,
    Material={diffuse=RGB(0, 191, 255), emission=RGB(66, 48, 66), shine=0.5, specular=RGB(255, 255, 255), transparency=0.6})  # disabled
uvn_2 = UVN(srf=python_9.keystone_surfaces)  # disabled

# ----
srf_9 = Surface(flatten(python_9.keystone_surfaces))  # disabled

# ---- group: surface visualization
uvn_3 = UVN(srf=srf_9)  # disabled
python_10 = GhPythonScript(s=srf_9)  # -> out, c; inputs s: Surface; disabled; same code as python_7
points_2 = PointList(Points=python_10.c, Size=panel_4)  # disabled

# ----
panel_7 = Panel("""0
2
4""")  # disabled
panel_8 = Panel("""1,0
2,3
4,5""")  # disabled
python_11 = GhPythonScript(surfaces=srf_9, surface_network_index=panel_8, top_priority_index=panel_7)  # -> out, beams, dowels, local_networks; inputs surfaces: list of Surface, surface_network_index: list, top_priority_index: list of Int32, has_loops: list of Boolean; disabled
# ---------- python_11: Python ----------
__author__ = "ytakzk"
__version__ = "2019.02.23"

import sys
import Rhino.Geometry as rg

from geometry import LocalNetwork, Surface

dowels = []
beams = []
tmp = []
local_networks = []

if len(surface_network_index) != len(top_priority_index):
    ValueError('surface_network_index must be the same size as top_priority_index')

# network

surface_network_sets = []
priorities = []

for string, priority_index in zip(surface_network_index, top_priority_index):
    
    values = string.split('&')

    surface_network = []
    
    priority_index_v = 0
    
    for v_values in values:

        surface_network_subset = []
        for v, index in enumerate(v_values.split(',')):
            
            index = int(index)

            if index == priority_index:
                
                priority_index_v = v
                
            surface = Surface(surfaces[index])
            surface_network_subset.append(surface)
            
        surface_network.append(surface_network_subset)
    
    priorities.append(priority_index_v)
    
    surface_network_sets.append(surface_network)

print priorities

for surface_network, top_priority_v_index in zip(surface_network_sets, priorities):

    local_network = LocalNetwork(surface_network, False, top_priority_v_index)

    local_dowels = local_network.add_three_beams_connection()
    dowels.extend([d.brep_representation() for d in local_dowels])

    local_dowels = local_network.add_two_beams_connection()
    dowels.extend([d.brep_representation() for d in local_dowels])

    local_beams = [b.brep_representation(make_holes=False) for b in local_network.get_flatten_beams()]
    beams.extend(local_beams)
    
    local_networks.append(local_network)
# ---------- end python_11 ----------
merge = Merge(Data1=python_6.local_networks, Data2=python_11.local_networks)  # disabled

# ---- group: fabrication sequence check
python_12 = GhPythonScript(local_networks=merge)  # -> out, beams, dowels; inputs local_networks: list; disabled
# ---------- python_12: Python ----------
__author__ = "ytakzk"
__version__ = "2019.02.24"

import System
import Grasshopper.Kernel.Data.GH_Path as ghpath
import Grasshopper.DataTree as datatree

beams = datatree[System.Object]()

for i, local_network in enumerate(local_networks):
    
    local_beams = [b.brep_representation(make_holes=False) for b in local_network.get_flatten_beams()]
    
    path = ghpath(i)
    
    for b in local_beams:
        beams.Add(b, path)
# ---------- end python_12 ----------
number_slider_4 = Slider(15, range=0..20)  # disabled
item_3 = ListItem(List=python_12.beams, Index=number_slider_4, Wrap=True)  # disabled
preview_2 = CustomPreview(
    Geometry=item_3,
    Material={diffuse=RGB(0, 255, 255), emission=RGB(66, 48, 66), shine=0.5, specular=RGB(255, 255, 255), transparency=0.3})  # disabled

# ----
python_13 = GhPythonScript()  # -> Out, A; disabled

# ==== cluster UVN
srf = ClusterInput()
number_slider = Slider(5, range=0..110)
extract_uv_vec = GhPythonScript(srf=srf)  # -> out, center_pt, u_vec, v_vec, normal; inputs srf: Surface
# ---------- extract_uv_vec: Python ----------
__author__ = "Wenqian"
__version__ = "2019.01.22"

import rhinoscriptsyntax as rs
import Rhino.Geometry as rg

srf.SetDomain(0,rg.Interval(0,1))
srf.SetDomain(1,rg.Interval(0,1))

center_pt = srf.PointAt(0.5,0.5)

u_vec = srf.FrameAt(0.5,0.5)[1].XAxis
v_vec = srf.FrameAt(0.5,0.5)[1].YAxis

normal =srf.NormalAt(0.5,0.5)
# ---------- end extract_uv_vec ----------
multiplication = Multiplication(A=extract_uv_vec.v_vec, B=500)
multiplication_2 = Multiplication(A=extract_uv_vec.normal, B=500)
multiplication_3 = Multiplication(A=extract_uv_vec.u_vec, B=500)
vdisex = VectorDisplayEx(
    Point=extract_uv_vec.center_pt,
    Vector=multiplication_3,
    Colour=ColourSwatch(SwatchColor=RGB(255, 0, 0)),
    Width=number_slider)
vdisex_2 = VectorDisplayEx(
    Point=extract_uv_vec.center_pt,
    Vector=multiplication,
    Colour=ColourSwatch(SwatchColor=RGB(33, 220, 0)),
    Width=number_slider)
vdisex_3 = VectorDisplayEx(
    Point=extract_uv_vec.center_pt,
    Vector=multiplication_2,
    Colour=ColourSwatch(SwatchColor=RGB(255, 255, 255)),
    Width=number_slider)
