# Grasshopper definition geometry_test_file.gh (Grasshopper 0.9.80)
# plug-ins: Python Interpreter

srf = Surface(<surface referenced from the Rhino model>)
python = PythonScript(surface=srf, u_div=Slider(74, range=0..100), v_div=Slider(7, range=0..20))  # -> out, line_visualisation, beam_visualisation, hole_visualisation; inputs surface: Surface, u_div: Int32, v_div: Int32
# ---------- python: Python ----------
# snippet of code to make this python component look for it's code in the parent folder of the .gh file

import os

ghComp = ghenv.Component
ghDoc = ghComp.OnPingDocument()

file_name = "simple_surface_divider.py"
gh_file_location = ghDoc.FilePath
parent = os.path.dirname(os.path.realpath(gh_file_location))

file_path = os.path.join(parent, file_name)
# print file_path

single_parent = os.path.dirname(os.path.realpath(parent))
double_parent = os.path.dirname(os.path.realpath(single_parent))
# print parent

# hacky-hacky run-fun
execfile(file_path)
# ---------- end python ----------
pt = Point(python.hole_visualisation)
